# Grasshopper definition QinghongShaoA4.gh (Grasshopper 1.0.8)
# plug-ins: RhinoCodePluginGH

# This is a cube with FreeStanding Lines added to its four inner outer corners and I don't set up it with bottom layer.
number_slider = Slider(30, range=0..100)
# This is a cube with a bottom face and FreeStanding Lines added to its four inner corners.
number_slider_2 = Slider(30, range=0..100)
# This is a polygonal pattern with vertical movement along the z-axis.
py3 = Python3Script()  # -> out, file; disabled
# ---------- py3: Python ----------
# script to generate a file for .gcode

import rhinoscriptsyntax as rs

filter = "GCode (*.gcode)|*.gcode|All Files (*.*)|*.*||"
file = rs.SaveFileName("", filter)
# ---------- end py3 ----------
# Large Assignment 4: G-CODE
# Qinghong Shao
# qinghongshao@unm.edu
# CS491/591, Computational Fabrication
# 10/19/2024
# This is a polygonal star shape with variations along the z-axis, primarily based on the t.forward_lift() function.
py3_2 = Python3Script()  # -> out, file; disabled; same code as py3
# This is a interesting shape I modify but fail to print well.
py3_3 = Python3Script()  # -> out, file; disabled; same code as py3
py3_4 = Python3Script()  # -> out, file; disabled; same code as py3
py3_5 = Python3Script()  # -> out, file; disabled; same code as py3
py3_6 = Python3Script(file=py3.file, radius=Slider(30, range=0..100))  # -> out, lines, turtle, print_bed; inputs file: String
# ---------- py3_6: Python ----------
import rhinoscriptsyntax as rs
import extruder_turtle
from extruder_turtle import *
import math

# set up the turtle and associate the turtle with a specific printer
t = ExtruderTurtle()
t.setup(x=0,y=0,filename=file, printer = "eazao")
t.rate(500)
# print out important printer parameters
t.print_printer_information()

# *************************************
# main part of program
# *************************************
# Pentagram
for l in range(10):
    vert = l/30

    for k in range(7):
        for x in range(-25, 25):
            horiz = x/25
            t.forward_lift(1, -vert*horiz*1)
        t.right(6*60/7)
    t.lift(0.15)




# *************************************
# end main part of program
# *************************************

# visualize the turtle's location and position
turtle = t.draw_turtle()

# visualize the printer's print bed
print_bed = t.draw_print_bed()

# get the path the turtle has traveled to visualize in Rhino
lines = t.get_lines()

# get print time and print it
time = t.get_print_time()
print("Approximate print time in minutes: " +str(time))

# close the generated .gcode file
t.finish()
# ---------- end py3_6 ----------
py3_7 = Python3Script(file=py3_2.file, radius=Slider(30, range=0..100))  # -> out, lines, turtle, print_bed; inputs file: String; disabled
# ---------- py3_7: Python ----------
import rhinoscriptsyntax as rs
import extruder_turtle
from extruder_turtle import *
import math

# set up the turtle and associate the turtle with a specific printer
t = ExtruderTurtle()
t.setup(x=0,y=0,filename=file, printer = "eazao")
t.rate(500)

t.print_printer_information()

# *************************************
# main part of program
# *************************************

for l in range(30):

    vert = l/30

    for k in range(7):
        for x in range(-25, 26):
            horiz = x / 15
            t.forward_lift(1, -vert*horiz*0.3)
        t.right(6*120/7)

    ## Move to the next layer
    t.lift(0.15)



# *************************************
# end main part of program
# *************************************

# visualize the turtle's location and position
turtle = t.draw_turtle()

# visualize the printer's print bed
print_bed = t.draw_print_bed()

# get the path the turtle has traveled to visualize in Rhino
lines = t.get_lines()

# get print time and print it
time = t.get_print_time()
print("Approximate print time in minutes: " +str(time))

# close the generated .gcode file
t.finish()
# ---------- end py3_7 ----------
py3_8 = Python3Script(file=py3_3.file, radius=number_slider)  # -> out, lines, turtle, print_bed; inputs file: String; disabled
# ---------- py3_8: Python ----------
import rhinoscriptsyntax as rs
import extruder_turtle
from extruder_turtle import *
import math

# set up the turtle and associate the turtle with a specific printer
t = ExtruderTurtle()
t.setup(x=0,y=0,filename=file, printer = "eazao")
t.rate(500)
# print out important printer parameters
t.print_printer_information()

# *************************************
# main part of program
# *************************************
# Pentagram

N = 120 #
period = 24 
angle = 2*180/N

for l in range(30):
    for k in range(period+1):
        t.forward(2)
        t.right(angle*k*(k-1)/2)
    t.lift(0.3)

# *************************************
# end main part of program
# *************************************

# visualize the turtle's location and position
turtle = t.draw_turtle()

# visualize the printer's print bed
print_bed = t.draw_print_bed()

# get the path the turtle has traveled to visualize in Rhino
lines = t.get_lines()

# get print time and print it
time = t.get_print_time()
#print("Approximate print time in minutes: " +str(time))

# close the generated .gcode file
t.finish()
# ---------- end py3_8 ----------
py3_9 = Python3Script(file=py3_4.file, radius=Slider(30, range=0..100))  # -> out, lines, turtle, print_bed; inputs file: String; disabled
# ---------- py3_9: Python ----------
import rhinoscriptsyntax as rs
import extruder_turtle
from extruder_turtle import *
import math

# set up the turtle and associate the turtle with a specific printer
t = ExtruderTurtle()
t.setup(x=0,y=0,filename=file, printer = "eazao")
t.rate(500)
# print out important printer parameters
t.print_printer_information()

# *************************************
# main part of program
# *************************************
size = 30
upper_size = 30
size_freestanding_line = 14
for i in range (26):
    if i == 0:
        for o in range (60): # four line of the square
            if o == 3:                    
                t.forward(size)
                t.right(90)
            else:
                t.forward(size)
                t.right(90)
                size -= 0.5
        t.lift(0.3)#then get to the second layer, we have finished the bottom

        t.penup()
        t.set_position(x=0,y=0,z=0.3)
        t.right(45+90)
        t.pendown()
    if i >= 1:# print freestanding lines in every even layers
        if i % 4 == 0:
            for x in range (4):
                t.forward(2*upper_size/3)

                t.right(45)
                t.forward(size_freestanding_line)
                t.penup()
                t.right(180)
                t.forward(size_freestanding_line)
                t.right(135)
                t.pendown()

                t.forward(upper_size/3)
                t.right(90)
                
            t.lift(0.3)
            print("i="+ str(i))

        else:
            for x in range (4):
                t.forward(upper_size)
                t.right(90)
            t.lift(0.3)

# *************************************
# end main part of program
# *************************************

# visualize the turtle's location and position
turtle = t.draw_turtle()

# visualize the printer's print bed
print_bed = t.draw_print_bed()

# get the path the turtle has traveled to visualize in Rhino
lines = t.get_lines()

# get print time and print it
time = t.get_print_time()
print("Approximate print time in minutes: " +str(time))

# close the generated .gcode file
t.finish()
# ---------- end py3_9 ----------
py3_10 = Python3Script(file=py3_5.file, radius=number_slider_2)  # -> out, lines, turtle, print_bed; inputs file: String; disabled
# ---------- py3_10: Python ----------
import rhinoscriptsyntax as rs
import extruder_turtle
from extruder_turtle import *
import math

# set up the turtle and associate the turtle with a specific printer
t = ExtruderTurtle()
t.setup(x=0,y=0,filename=file, printer = "eazao")
t.rate(500)
# print out important printer parameters
t.print_printer_information()

# *************************************
# main part of program
# *************************************
size = 30
upper_size = 30
size_freestanding_line = 8
for i in range (30):
    ''' I skip the bottom layer
    if i == 0:
        for o in range (60): # four line of the square
            if o == 3:                    
                t.forward(size)
                t.right(90)
            else:
                t.forward(size)
                t.right(90)
                size -= 0.5
        t.lift(0.3)#then get to the second layer, we have finished the bottom
        #t.setup(x=0,y=0,z=0.3)
        t.penup()
        t.set_position(x=0,y=0,z=0.3)
        t.right(45+90)
        t.pendown()
    '''
    if i >= 0:
        if i == 25:
            for x in range (4):
                t.forward(upper_size/2)

                t.left(60)
                t.forward(size_freestanding_line)
                t.right(120)
                t.forward(size_freestanding_line)
                t.left(60)

                t.forward((upper_size/2) -size_freestanding_line)
                t.right(90)
                t.lift(0.3)
                print("i="+ str(i))

        else:
            for x in range (4):
                t.forward(upper_size)
                t.right(90)
                t.lift(0.3)

# *************************************
# end main part of program
# *************************************

# visualize the turtle's location and position
turtle = t.draw_turtle()

# visualize the printer's print bed
#print_bed = t.draw_print_bed()

# get the path the turtle has traveled to visualize in Rhino
lines = t.get_lines()

# get print time and print it
#time = t.get_print_time()
#print("Approximate print time in minutes: " +str(time))

# close the generated .gcode file
t.finish()
# ---------- end py3_10 ----------
srf = Surface(py3_6.turtle)
crv = Curve(py3_6.lines)
srf_2 = Surface(py3_6.print_bed)
srf_3 = Surface(py3_7.turtle)
crv_2 = Curve(py3_7.lines)
srf_4 = Surface(py3_7.print_bed)
srf_5 = Surface(py3_8.turtle)
srf_6 = Surface(py3_8.print_bed)
crv_3 = Curve(py3_8.lines)
srf_7 = Surface(py3_9.turtle)
srf_8 = Surface(py3_9.print_bed)
srf_9 = Surface(py3_10.turtle)
srf_10 = Surface(py3_10.print_bed)
crv_4 = Curve(py3_9.lines)
crv_5 = Curve(py3_10.lines)
